# Grasshopper definition surface-framework.gh (Grasshopper 0.9.76)
# plug-ins: HDTReference

# ---- group: Input
# Post Dimensions
# Surface
# Weaving
# Fringe
thickness_inches = Slider(1.75, range=0..12)
single_length_inches = Slider(42, range=0..72)
possible_post_sizes_inches = Panel("""12
24
36
48
60
72""")
number_of_ideal_lengths = Slider(6, range=1..12)
list = ValueList({"Use list of post sizes": 0, "Use single post length": 1, "Assign ideal lengths": 2}, selected="Use single post length")
flip_u = BooleanToggle(False)
flip_v = BooleanToggle(False)
fringe_length = Slider(0, range=0..60)
flip_fringe_direction = BooleanToggle(False)
fringe_angle = Slider(3, range=0..3)
srf = Surface(reparameterize(<surface referenced from the Rhino model>))
u_divisions = Slider(4, range=0..20)
min_offset_from_end_mult_by_thickness = Slider(2.5, range=0..6)
v_divisions = Slider(3, range=0..20)
even_column_factor = Slider(0.325, range=0..1)
curvature_offset_min = Slider(0, range=0..10)
curvature_offset_max = Slider(5.534, range=0..10)
intersection_distance_warning_inches = Slider(1, range=0..4)
intersection_distance_limit_inches = Slider(3, range=0..4)
minimum_offset_inches = Slider(1.97, range=0..12)
maximum_offset_inches = Slider(2.88, range=0..24)

# ----
remove_posts_below_ground_z_0 = BooleanToggle(True)
cutoff_point_on_posts_below_ground = Slider(0.5, range=0..1)
sorting_axis = Curve(<curve referenced from the Rhino model>)
crv = Curve(reparameterize(<curve referenced from the Rhino model>))

iso = IsoCurve(Surface=srf, UVPoint=Point(0.5, 0.5, 0))  # -> UIsocurve, VIsocurve
cls = Closed(Curve=iso.UIsocurve)  # -> Closed, Periodic
cls_2 = Closed(Curve=iso.VIsocurve)  # -> Closed, Periodic

divide = DivideCurve(Curve=crv, Count=Slider(10, range=0..10), Kinks=False)  # -> Points, Tangents, Parameters
shatter = Shatter(Curve=crv, Parameters=divide.Parameters)

range = Range(Domain=Domain(0, 1), Steps=u_divisions)
range_2 = Range(Domain=Domain(0, 1), Steps=v_divisions)
graph = GraphMapper(range, x0=0, x1=1, y0=0, y1=1, container_name="Bezier", cpx=[0, 0.25, 0.75, 1], cpy=[0, 0.25, 0.75, 1])
graph_2 = GraphMapper(range_2, x0=0, x1=1, y0=0, y1=1, container_name="Bezier", cpx=[0, 0.25, 0.75, 1], cpy=[0, 0.25, 0.75, 1])
consec = ConsecutiveDomains(Numbers=graph, Additive=False)
consec_2 = ConsecutiveDomains(Numbers=graph_2, Additive=False)
dom² = Domain²(DomainU=graft(consec), DomainV=consec_2)

bake_axes = Button()
bake_labels = Button()

# ---- group: divide surface
subsrf = Isotrim(Surface=srf, Domain=dom²)
explode = BrepComponents(Brep=subsrf)  # -> Faces, reparameterize(simplify(Edges)), Vertices
item = ListItem(List=explode.Edges, Index=0, Wrap=False)  # -> Item, Item1, Item2, Item3

# ---- group: Edges of quadpanel
eval = EvaluateCurve(Curve=item.Item2, Parameter=0.5)  # -> Point, Tangent, Angle
eval_2 = EvaluateCurve(Curve=item.Item, Parameter=0.5)  # -> Point, Tangent, Angle
ln = Line(PointA=eval.Point, PointB=eval_2.Point)

# ---- group: Hexagon vertices
eval_3 = EvaluateCurve(Curve=item.Item1, Parameter=even_column_factor)  # -> Point, Tangent, Angle
eval_4 = EvaluateCurve(Curve=item.Item1, Parameter=expr("1-x", even_column_factor))  # -> Point, Tangent, Angle
eval_5 = EvaluateCurve(Curve=item.Item3, Parameter=even_column_factor)  # -> Point, Tangent, Angle
eval_6 = EvaluateCurve(Curve=item.Item3, Parameter=expr("1-x", even_column_factor))  # -> Point, Tangent, Angle
eval_7 = EvaluateCurve(Curve=ln, Parameter=expr("x/2", even_column_factor))  # -> Point, Tangent, Angle
eval_8 = EvaluateCurve(Curve=ln, Parameter=expr("1-x/2", even_column_factor))  # -> Point, Tangent, Angle

# ----
merge = Merge(Data1=eval_6.Point, Data2=eval_8.Point, Data3=eval_3.Point, Data4=eval_4.Point, Data5=eval_7.Point, Data6=eval_5.Point)
srf_cp = SurfaceCP(Point=merge, Surface=srf)  # -> Point, UVPoint, Distance
item_2 = ListItem(List=srf_cp.Point, Index=0, Wrap=False)  # -> Item, Item1, Item2, Item3, Item4, Item5

# ---- group: connect hexagon rows, or extend to edge
pshift = ShiftPaths(Data=eval_2.Point, Offset=-1)
partition = PartitionList(List=flatten(item_2.Item4), Size=v_divisions)
partition_2 = PartitionList(List=flatten(item_2.Item1), Size=v_divisions)
item_3 = ListItem(List=pshift, Index=0, Wrap=True)
replace = ReplaceItems(List=partition, Item=item_3, Indices=expr("x-1", v_divisions), Wrap=False)
filter = StreamFilter(Gate=cls_2.Closed, Stream0=replace, Stream1=partition)
shift = ShiftList(List=filter, Shift=-1, Wrap=True)
ln_2 = Line(PointA=shift, PointB=partition_2)

# ---- group: single post length
equals = Equality(FirstNumber=list, SecondNumber=1)  # -> Equality, Inequality
cull = CullPattern(List=single_length_inches, CullPattern=equals.Equality)

# ---- group: Hex edges
tops = Line(PointA=item_2.Item2, PointB=item_2.Item3)
tops_2 = Line(PointA=item_2.Item3, PointB=item_2.Item4)
tops_3 = Line(PointA=item_2.Item4, PointB=item_2.Item5)
tops_4 = Line(PointA=item_2.Item1, PointB=item_2.Item)
tops_5 = Line(PointA=item_2.Item2, PointB=item_2.Item1)
line = Line(simplify(graft(ln_2)))
merge_2 = Merge(Data1=graft(tops), Data2=graft(tops_2), Data3=graft(tops_3), Data4=graft(tops_4), Data5=graft(tops_5), Data6=graft(line))  # -> simplify(Result)

# ---- group: hexagon grid
preview = CustomPreview(Geometry=merge_2, Shader=ColourSwatch(SwatchColor=RGB(94, 94, 94)))

# ---- group: edge endpoints
end = EndPoints(Curve=merge_2)  # -> Start, End
merge_3 = Merge(Data1=graft(end.Start), Data2=graft(end.End))

# ----
pshift_2 = ShiftPaths(Data=merge_3, Offset=-1)

# ---- group: recombine by intersections
item_4 = ListItem(List=pshift_2, Index=0, Wrap=False)  # -> Item, Item1, Item2, Item3, Item4, Item5, Item6, Item7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
merge_4 = Merge(Data1=cls.Closed, Data2=cls_2.Closed)
path_offset = PathOffset(T=item_4.Item11, offset="{0;-1}", wrap=merge_4, clip=True)
path_offset_2 = PathOffset(T=item_4.Item4, offset="{-1;0}", wrap=merge_4, clip=True)
path_offset_3 = PathOffset(T=item_4.Item6, offset="{-1;0}", wrap=merge_4, clip=True)
merge_5 = Merge(Data1=item_4.Item, Data2=item_4.Item3, Data3=path_offset_2)
merge_6 = Merge(Data1=item_4.Item1, Data2=path_offset_3, Data3=item_4.Item9)
merge_7 = Merge(Data1=item_4.Item7, Data2=item_4.Item8, Data3=item_4.Item10)
merge_8 = Merge(Data1=item_4.Item5, Data2=path_offset, Data3=item_4.Item2)
entwine = Entwine(Branch0X=merge_5, Branch1X=merge_6, Branch2X=merge_8, Branch3X=merge_7, FlattenInputs=False)

# ---- group: matching intersection center
entwine_2 = Entwine(Branch0X=item_4.Item1, Branch1X=item_4.Item, Branch2X=item_4.Item4, Branch3X=item_4.Item9, FlattenInputs=False)

# ---- group: remapping pattern
index = ItemIndex(List=flatten(entwine), Item=graft(pshift_2))
pshift_3 = ShiftPaths(Data=index, Offset=-1)

# ---- group: curvature offset
lng = ListLength(List=entwine)
avr = Average(Input=entwine)
equals_2 = Equality(FirstNumber=lng, SecondNumber="3")  # -> Equality, Inequality
dist = Distance(PointA=entwine_2, PointB=avr)
panel = Panel("0")
p_n_c = PickNChoose(Pattern=equals_2.Equality, Stream0=curvature_offset_min, Stream1=dist)
dup = DuplicateData(Data=p_n_c, Number=lng, Order=True)
item_5 = ListItem(List=flatten(dup), Index=pshift_3, Wrap=False)
dom = Domain(DomainStart=curvature_offset_min, DomainEnd=curvature_offset_max)
remap = RemapNumbers(Value=item_5, Source=dom, Target=Domain(0, 1))  # -> Mapped, Clipped

ln_3 = Line(StartPoint=entwine_2, EndPoint=avr)
gradient = Gradient(
    LowerLimit=0,
    UpperLimit=1,
    Parameter=remap.Mapped,
    stops=[0: RGB(234, 38, 0), 0.25: RGB(234, 126, 0), 0.5: RGB(254, 244, 84), 0.75: RGB(173, 203, 249), 1: RGB(75, 107, 169)])
preview_2 = CustomPreview(Geometry=ln_3, Shader=gradient)

# ---- group: Remap curvature offset to edge offset
normalized_curvature = Number(remap.Mapped)
dom_2 = Domain(DomainStart=maximum_offset_inches, DomainEnd=minimum_offset_inches)
remap_2 = RemapNumbers(Values=normalized_curvature, Source=Domain(0, 1), Target=dom_2)  # -> Result, Clipped
dispatch = Dispatch(List=remap_2.Clipped, DispatchPattern=[True, False])  # -> ListA, ListB

# ---- group: Offset from end
len = Length(Curve=merge_2)
subtraction = Subtraction(A=len, B=dispatch.ListA)
eval_9 = EvaluateLength(Curve=merge_2, Length=subtraction, Normalized=False)  # -> Point, Tangent, Parameter

# ---- group: Offset from start
eval_10 = EvaluateLength(Curve=merge_2, Length=dispatch.ListB, Normalized=False)  # -> Point, Tangent, Parameter

# ----
item_6 = ListItem(List=simplify(eval_9.Point), Index=0, Wrap=True)  # -> Item, Item1, Item2, Item3, Item4, Item5
item_7 = ListItem(List=simplify(eval_10.Point), Index=0, Wrap=True)  # -> Item, Item1, Item2, Item3, Item4, Item5

wrap_u = Boolean(cls.Closed)
wrap_v = Boolean(cls_2.Closed)

# ---- group: Post axes
relitem2 = RelativeItems(TreeA=item_7.Item1, TreeB=item_6.Item3, Offset="{1;0}(0)", WrapPaths=wrap_u, WrapItems=False)  # -> ItemA, ItemB
relitem2_2 = RelativeItems(TreeA=item_7.Item2, TreeB=item_6.Item2, Offset="{1;0}(0)", WrapPaths=wrap_u, WrapItems=False)  # -> ItemA, ItemB
relitem2_3 = RelativeItems(TreeA=item_6.Item, TreeB=item_7.Item5, Offset="{1;1}(0)", WrapPaths=wrap_u, WrapItems=False)  # -> ItemA, ItemB
relitem2_4 = RelativeItems(TreeA=item_7.Item4, TreeB=item_6.Item4, Offset="{1;0}(0)", WrapPaths=wrap_u, WrapItems=False)  # -> ItemA, ItemB
relitem2_5 = RelativeItems(TreeA=item_7.Item, TreeB=item_6.Item5, Offset="{0;0}(0)", WrapPaths=False, WrapItems=False)  # -> ItemA, ItemB
relitem2_6 = RelativeItems(TreeA=item_6.Item1, TreeB=item_7.Item3, Offset="{0;1}(0)", WrapPaths=wrap_v, WrapItems=False)  # -> ItemA, ItemB
tops_6 = Line(PointA=relitem2.ItemA, PointB=relitem2.ItemB, DataComparison="shortest_list")
tops_7 = Line(PointA=relitem2_2.ItemA, PointB=relitem2_2.ItemB, DataComparison="shortest_list")
tops_8 = Line(PointA=relitem2_3.ItemA, PointB=relitem2_3.ItemB, DataComparison="shortest_list")
tops_9 = Line(PointA=relitem2_4.ItemA, PointB=relitem2_4.ItemB, DataComparison="shortest_list")
tops_10 = Line(PointA=relitem2_5.ItemB, PointB=relitem2_5.ItemA)
tops_11 = Line(PointA=relitem2_6.ItemA, PointB=relitem2_6.ItemB)

# ---- group: Pair intersecting posts
merge_9 = Merge(Data1=tops_9, Data2=tops_7)
relitem2_7 = RelativeItems(TreeA=tops_7, TreeB=tops_8, Offset="{0;0}(0)", WrapPaths=False, WrapItems=False)  # -> ItemA, ItemB
relitem2_8 = RelativeItems(TreeA=tops_7, TreeB=tops_8, Offset="{-1;0}", WrapPaths=wrap_u, WrapItems=False)  # -> ItemA, ItemB
relitem2_9 = RelativeItems(TreeA=tops_8, TreeB=tops_6, Offset="{0;0}(0)", WrapPaths=False, WrapItems=False)  # -> ItemA, ItemB
relitem2_10 = RelativeItems(TreeA=tops_8, TreeB=tops_11, Offset="{1;0}", WrapPaths=wrap_u, WrapItems=False)  # -> ItemA, ItemB
relitem2_11 = RelativeItems(TreeA=tops_9, TreeB=tops_10, Offset="{0;0}(0)", WrapPaths=False, WrapItems=False)  # -> ItemA, ItemB
relitem2_12 = RelativeItems(TreeA=tops_9, TreeB=tops_10, Offset="{1;0}", WrapPaths=wrap_u, WrapItems=False)  # -> ItemA, ItemB
relitem2_13 = RelativeItems(TreeA=tops_10, TreeB=tops_6, Offset="{0;0}(0)", WrapPaths=False, WrapItems=False)  # -> ItemA, ItemB
relitem2_14 = RelativeItems(TreeA=tops_10, TreeB=tops_11, Offset="{0;-1}", WrapPaths=wrap_v, WrapItems=False)  # -> ItemA, ItemB
relitem2_15 = RelativeItems(TreeA=tops_11, TreeB=tops_7, Offset="{0;0}(0)", WrapPaths=False, WrapItems=False)  # -> ItemA, ItemB
relitem2_16 = RelativeItems(TreeA=tops_11, TreeB=tops_9, Offset="{-1;1}", WrapPaths=wrap_u, WrapItems=False)  # -> ItemA, ItemB
merge_10 = Merge(Data1=tops_6, Data2=tops_6)
merge_11 = Merge(Data1=relitem2_7.ItemA, Data2=relitem2_8.ItemA)
merge_12 = Merge(Data1=relitem2_7.ItemB, Data2=relitem2_8.ItemB)
merge_13 = Merge(Data1=relitem2_9.ItemA, Data2=relitem2_10.ItemA)
merge_14 = Merge(Data1=relitem2_9.ItemB, Data2=relitem2_10.ItemB)
merge_15 = Merge(Data1=relitem2_11.ItemA, Data2=relitem2_12.ItemA)
merge_16 = Merge(Data1=relitem2_12.ItemB, Data2=relitem2_11.ItemB)
merge_17 = Merge(Data1=relitem2_13.ItemA, Data2=relitem2_14.ItemA)
merge_18 = Merge(Data1=relitem2_14.ItemB, Data2=relitem2_13.ItemB)
merge_19 = Merge(Data1=relitem2_15.ItemA, Data2=relitem2_16.ItemA)
merge_20 = Merge(Data1=relitem2_15.ItemB, Data2=relitem2_16.ItemB)
entwine_3 = Entwine(
    Branch0X=merge_10,
    Branch1X=merge_11,
    Branch2X=merge_13,
    Branch3X=merge_15,
    Branch4X=merge_17,
    Branch5X=merge_19,
    FlattenInputs=False)
entwine_4 = Entwine(
    Branch0X=merge_9,
    Branch1X=merge_12,
    Branch2X=merge_14,
    Branch3X=merge_16,
    Branch4X=merge_18,
    Branch5X=merge_20,
    FlattenInputs=False)

# ---- group: joint locations
llx = LineLine(Line1=entwine_3, Line2=entwine_4)  # -> ParamA, ParamB, PointA, PointB
entwine_5 = Entwine(
    Branch0X=tops_6,
    Branch1X=tops_7,
    Branch2X=tops_8,
    Branch3X=tops_9,
    Branch4X=tops_10,
    Branch5X=tops_11,
    FlattenInputs=False)
relitem2_17 = RelativeItems(TreeA=llx.PointA, TreeB=entwine_5, Offset="{0;0;0}", WrapPaths=False, WrapItems=True)  # -> ItemA, ItemB

# ---- group: remove joint axes on edges
ln_4 = Line(StartPoint=llx.PointA, EndPoint=llx.PointB)
wrap_u_2 = Boolean(cls.Closed)
wrap_v_2 = Boolean(cls_2.Closed)
expression = Expression(V=v_divisions, Expression="V-1")
format = Format(Format="{{0;?;{0}}}", Culture=127, Data0=expression)
filter_2 = StreamFilter(Gate=wrap_v_2, Stream0=format, Stream1="{0}")
split = SplitTree(Data=ln_4, Masks=flatten(filter_2))  # -> Positive, Negative
item_8 = ListItem(List=split.Positive, Index=0, Wrap=True)
line_2 = Line([split.Negative, item_8])

# ---- group: joint axes
preview_3 = CustomPreview(Geometry=line_2, Shader=ColourSwatch(SwatchColor=RGB(0, 183, 0)))

# ---- group: separate posts at edge
lng_2 = ListLength(List=relitem2_17.ItemA)
equals_3 = Equality(FirstNumber=lng_2, SecondNumber="2")  # -> Equality, Inequality
dispatch_2 = Dispatch(List=relitem2_17.ItemA, DispatchPattern=equals_3.Equality)  # -> ListA, ListB

# ---- group: post axes on edges
expression_2 = Expression(U=u_divisions, Expression="U-1")
expression_3 = Expression(U=u_divisions, Expression="U-1")
pt = Point(dispatch_2.ListB)
format_2 = Format(Format="{{5;{0};?}}", Culture=127, Data0=expression_3)
format_3 = Format(Format="{{4;{0};?}}", Culture=127, Data0=expression_2)
split_2 = SplitTree(Data=pt, Masks=flatten("{4;?;0}"))  # -> Positive, Negative
split_3 = SplitTree(Data=pt, Masks=flatten("{1;0;?}"))  # -> Positive, Negative
split_4 = SplitTree(Data=pt, Masks=flatten(format_2))  # -> Positive, Negative
split_5 = SplitTree(Data=pt, Masks=flatten(format_3))  # -> Positive, Negative
split_6 = SplitTree(Data=pt, Masks=flatten("{5;0;?}"))  # -> Positive, Negative
relitem2_18 = RelativeItems(TreeA=split_2.Positive, TreeB=llx.PointB, Offset="{-1;-1;0}(0)", WrapPaths=wrap_u_2, WrapItems=False)  # -> ItemA, ItemB
relitem2_19 = RelativeItems(TreeA=split_6.Positive, TreeB=llx.PointB, Offset="{-1;0;1}(0)", WrapPaths=wrap_u_2, WrapItems=False)  # -> ItemA, ItemB
relitem2_20 = RelativeItems(TreeA=split_4.Positive, TreeB=llx.PointB, Offset="{-3;-1;0}(1)", WrapPaths=wrap_u_2, WrapItems=False)  # -> ItemA, ItemB
ln_5 = Line(StartPoint=relitem2_18.ItemB, EndPoint=relitem2_18.ItemA)
ln_6 = Line(StartPoint=relitem2_19.ItemA, EndPoint=relitem2_19.ItemB)
ln_7 = Line(StartPoint=split_3.Positive, EndPoint=split_6.Positive)
ln_8 = Line(StartPoint=relitem2_20.ItemB, EndPoint=relitem2_20.ItemA)

# ---- group: post axes
item_9 = ListItem(List=dispatch_2.ListA, Index=0, Wrap=False)  # -> Item, Item1
ln_9 = Line(StartPoint=item_9.Item, EndPoint=item_9.Item1)
clean = CleanTree(RemoveNulls=True, RemoveInvalid=True, RemoveEmpty=True, Tree=ln_9)

# ---- group: Find separated posts
dom_3 = Domain(DomainStart=intersection_distance_warning_inches, DomainEnd=intersection_distance_limit_inches)
inc = Includes(Value=line_2, Domain=dom_3)  # -> Includes, Deviation
cull_2 = CullPattern(List=line_2, CullPattern=inc.Includes)  # -> flatten(List)
vlen = VectorLength(Vector=cull_2)
bnd = Bounds(Numbers=expr("-x", vlen))
dom_4 = Domain(DomainStart=0, DomainEnd=0.7)
remap_3 = RemapNumbers(Values=expr("-x", vlen), Source=bnd, Target=dom_4)  # -> Result, Clipped
hsl = ColourHSL(Alpha=1, Hue=remap_3.Result, Saturation=1, Luminance=0.5)

# ---- group: separated joints
lng_3 = ListLength(List=cull_2)
color = Colour(hsl)
joints = Curve(cull_2)
curvepoint = PointOnCurve(joints, parameter=0.5)
panel_2 = Panel(lng_3)
preview_4 = CustomPreview(Geometry=joints, Shader=color)
dots = DotDisplay(Point=curvepoint, Colour=color, Size=1.5)

# ----
previewlw = CustomPreviewLineweights(Geometry=joints, Shader=color, Thickness=5)
num = Number(vlen)
# Problematic separation distances
bar_graph = BarGraph(num, BarColor=RGB(255, 0, 90))

# ---- group: Post axes: minimum necessary
merge_21 = Merge(Data1=[ln_7, ln_6, ln_5, ln_8], Data2=clean)
multiplication = Multiplication(A=thickness_inches, B=min_offset_from_end_mult_by_thickness)
ext = Extend(Curve=merge_21, Type=0, Start=multiplication, End=multiplication)
pshift_4 = ShiftPaths(Data=ext, Offset=-2)

# ---- group: post axes: minimum necessary
preview_5 = CustomPreview(Geometry=ext, Shader=ColourSwatch(SwatchColor=RGB(0, 115, 255)))

# ---- group: Flip fringe direction
not = GateNot(A=flip_fringe_direction)
multiplication_2 = Multiplication(A=fringe_length, B=not)
multiplication_3 = Multiplication(A=fringe_length, B=flip_fringe_direction)

# ---- group: make fringe
ext_2 = Extend(Curve=pshift_4, Type=0, Start=multiplication_2, End=multiplication_3)  # -> simplify(Curve)
bang = ExplodeTree(Data=pshift_4)  # -> Branch0, Branch1, Branch2, Branch3, Branch4, Branch5
bang_2 = ExplodeTree(Data=ext_2)  # -> Branch0, Branch1, Branch2, Branch3, Branch4, Branch5
entwine_6 = Entwine(
    Branch00=bang_2.Branch0,
    Branch01=bang.Branch1,
    Branch02=bang.Branch2,
    Branch03=bang.Branch3,
    Branch04=bang.Branch4,
    Branch05=bang_2.Branch5,
    FlattenInputs=True)
entwine_7 = Entwine(
    Branch00=bang.Branch0,
    Branch01=bang_2.Branch1,
    Branch02=bang.Branch2,
    Branch03=bang_2.Branch3,
    Branch04=bang.Branch4,
    Branch05=bang.Branch5,
    FlattenInputs=True)
entwine_8 = Entwine(
    Branch00=bang.Branch0,
    Branch01=bang.Branch1,
    Branch02=bang_2.Branch2,
    Branch03=bang.Branch3,
    Branch04=bang_2.Branch4,
    Branch05=bang.Branch5,
    FlattenInputs=True)
filter_3 = StreamFilter(Gate=fringe_angle, Stream0=pshift_4, Stream1=entwine_6, Stream2=entwine_7, Stream3=entwine_8)  # -> flatten(Stream)

# ---- group: Remove posts outside trim
end_2 = EndPoints(Curve=filter_3)  # -> Start, End
merge_22 = Merge(Data1=graft(end_2.Start), Data2=graft(end_2.End))
untrim = Untrim(Surface=srf)
srf_cp_2 = SurfaceCP(Point=merge_22, Surface=untrim)  # -> Point, UVPoint, Distance
trim = TrimInclusion(Surface=srf, UVPoint=srf_cp_2.UVPoint)
mm = MassMultiplication(Input=trim)  # -> Result, PartialResults
cull_3 = CullPattern(List=filter_3, CullPattern=flatten(mm.Result))

# ---- group: Remove posts below ground (z=0)
eval_11 = EvaluateLength(Curve=cull_3, Length=cutoff_point_on_posts_below_ground, Normalized=True)  # -> Point, Tangent, Parameter
pcomp = Deconstruct(Point=eval_11.Point)  # -> XComponent, YComponent, ZComponent
larger = LargerThan(FirstNumber=pcomp.ZComponent, SecondNumber=0)  # -> LargerThan, OrEqualTo
cull_4 = CullPattern(List=cull_3, CullPattern=larger.LargerThan)
filter_4 = StreamFilter(Gate=remove_posts_below_ground_z_0, Stream0=cull_3, Stream1=cull_4)

# ---- group: choose method of assigning post lengths
len_2 = Length(Curve=filter_4)  # -> flatten(Length)
gate = StreamGate(Stream=len_2, Gate=list)  # -> Target0, Target1, Target2

# ----
num_2 = Number(len_2)
# Minimum Post Lengths
post_lengths = BarGraph(num_2, BarColor=RGB(255, 0, 90))

# ---- group: Vary post lengths: given lengths
sort = SortList(Keys=possible_post_sizes_inches)  # -> Keys, ValuesA
ins = ListInsert(List=sort.Keys, Item=0, Indices=0, Wrap=False)
item_10 = ListItem(List=reverse(sort.Keys), Index=0, Wrap=False)
multiplication_4 = Multiplication(A=ins, B=12)
ins_2 = ListInsert(List=sort.Keys, Item=item_10, Indices=0, Wrap=False)
consec_3 = ConsecutiveDomains(Numbers=multiplication_4, Additive=False)
multiplication_5 = Multiplication(A=ins_2, B=12)
fdom = FindDomain(Domains=consec_3, Number=gate.Target0, Strict=False)  # -> Index, Neighbour
item_11 = ListItem(List=multiplication_5, Index=expr("x+1", fdom.Index), Wrap=False)

# ---- group: Vary post lengths: even intervals
bnd_2 = Bounds(Numbers=gate.Target2)
div = DivideDomain(Domain=bnd_2, Count=number_of_ideal_lengths)
fdom_2 = FindDomain(Domains=div, Number=gate.Target2, Strict=False)  # -> Index, Neighbour
domcomp = DomainComponents(Domain=div)  # -> Start, End
item_12 = ListItem(List=domcomp.End, Index=fdom_2.Index, Wrap=False)

# ----
combine = CombineData(Input0=item_11, Input1=cull, Input2=item_12)  # -> Result, Index
subtraction_2 = Subtraction(A=combine.Result, B=len_2)
num_3 = Number(combine.Result)
# Post Lengths
post_lengths_2 = BarGraph(num_3, BarColor=RGB(255, 0, 90))
# Increase in post length
increase_in_post_length = BarGraph(subtraction_2, BarColor=RGB(255, 0, 90))

# ---- group: axes too long for posts
smaller = SmallerThan(FirstNumber=len_2, SecondNumber=combine.Result)  # -> SmallerThan, OrEqualTo
dispatch_3 = Dispatch(List=flatten(filter_4), DispatchPattern=smaller.OrEqualTo)  # -> ListA, ListB
cull_5 = CullPattern(List=combine.Result, CullPattern=smaller.OrEqualTo)

# ---- group: long axes
# Preview
swatch = ColourSwatch(SwatchColor=RGB(255, 0, 0))
preview_6 = CustomPreview(Geometry=dispatch_3.ListB, Shader=swatch)

# ----
lng_4 = ListLength(List=dispatch_3.ListB)
post_axes_too_long = Panel(lng_4)

# ---- group: Post Boxes
eval_12 = EvaluateLength(Curve=dispatch_3.ListA, Length=0.5, Normalized=True)  # -> Point, Tangent, Parameter
pl = PlaneNormal(Origin=eval_12.Point, ZAxis=eval_12.Tangent)
box = CenterBox(Base=pl, X=expr("x/2", thickness_inches), Y=expr("x/2", thickness_inches), Z=expr("x/2", cull_5))

# ---- group: post solids
preview_7 = CustomPreview(Geometry=box, Shader=ColourSwatch(SwatchColor=RGB(186, 186, 186)))

# ---- group: Post Axes
pt_2 = PointOriented(System=pl, XComponent=0, YComponent=0, ZComponent=expr("-x/2", combine.Result))
line_3 = LineSDL(Start=pt_2, Direction=eval_12.Tangent, Length=combine.Result)

# ---- group: post axes
preview_8 = CustomPreview(Geometry=line_3, Shader=ColourSwatch(SwatchColor=RGB(255, 255, 255)))

# ---- group: Output
axes = Curve(line_3)
joints_2 = Curve(line_2)
posts = Brep(box)

# ----
lng_5 = ListLength(List=flatten(posts))
number_of_posts = Panel(lng_5)

# ---- group: label page layout
page_x = Slider(8.5, range=0..24)
width = Slider(2.63, range=1..6)
height = Slider(1, range=1..6)
x_margin = Slider(0.19, range=0..1)
y_margin = Slider(0.5, range=0..1)
page_y = Slider(11, range=0..24)
number_of_posts_2 = Integer(number_of_posts)
expression_4 = Expression(pX=page_x, x=width, mX=x_margin, Expression="floor((pX-2*mX)/x)")
expression_5 = Expression(pY=page_y, y=height, mY=y_margin, Expression="floor((pY-2*mY)/y)")
expression_6 = Expression(x=expression_4, y=expression_5, n=number_of_posts_2, Expression="ceiling(n/(x*y))")
expression_7 = Expression(pX=page_x, x=width, mX=x_margin, nX=expression_4, Expression="(pX-2*mX-x)/(nX-1)")
expression_8 = Expression(pY=page_y, y=height, mY=y_margin, nY=expression_5, Expression="(pY-2*mY-y)/(nY-1)")
recgrid = Rectangular(
    Plane=PlaneXY(0, 0, 0),
    SizeX=expression_7,
    SizeY=expression_8,
    ExtentX=expr("x-1", expression_4),
    ExtentY=expr("x-1", expression_5))  # -> Cells, Points
vec = VectorXYZ(XComponent=x_margin, YComponent=y_margin, ZComponent=0)  # -> Vector, Length
series = Series(Start=0, Step=expr("x+.5", page_x), Count=expression_6)
move = Move(Geometry=flatten(recgrid.Points), Motion=vec.Vector)  # -> Geometry, Transform
rectangle = Rectangle(Plane=PlaneXY(0, 0, 0), XSize=page_x, YSize=page_y, Radius=0)  # -> Rectangle, Length
X = UnitX(Factor=series)
move_2 = Move(Geometry=move.Geometry, Motion=graft(X))  # -> Geometry, Transform
move_3 = Move(Geometry=rectangle.Rectangle, Motion=X)  # -> Geometry, Transform
rectangle_2 = Rectangle(Plane=move_2.Geometry, XSize=width, YSize=height, Radius=0)  # -> flatten(Rectangle), Length
createatts = CreateAttributes(LayerName="page", enableFullPath=False)
crv_2 = Curve([move_3.Geometry, rectangle_2.Rectangle])
bake = BakeGeometry(Bake=bake_labels, Geometry=crv_2, Attributes=createatts)

# ---- group: number and bake post axes
post_axes = Curve(line_3)
sorting_axis_2 = Curve(sorting_axis)
curvepoint_2 = PointOnCurve(post_axes, parameter=0.5)
crv_cp = CurveClosestPoint(Point=curvepoint_2, Curve=reparameterize(sorting_axis_2))  # -> Point, Parameter, Distance
pt_3 = PointOriented(System=pl, XComponent=0, YComponent=0, ZComponent=expr("-x/2 - 2", combine.Result))
lng_6 = ListLength(List=post_axes)
sort_2 = SortList(Keys=crv_cp.Parameter, ValuesA=post_axes, ValuesB=pt_3)  # -> Keys, ValuesA, ValuesB
series_2 = Series(Start=0, Step=1, Count=lng_6)
int = Integer(series_2)
createatts_2 = CreateAttributes(Name=int, LayerName="axes", enableFullPath=False)
bake_2 = BakeGeometry(Bake=bake_axes, Geometry=sort_2.ValuesA, Attributes=createatts_2)

# ---- group: post ids
tag = TextTag(Location=sort_2.ValuesB, Text=int, Colour=ColourSwatch(SwatchColor=RGB(255, 255, 255)))

# ---- group: find connecting post numbers
sorted_posts = Curve(sort_2.ValuesA)
lng_7 = ListLength(List=sorted_posts)
crvprox = CurveProximity(CurveA=simplify(graft(sorted_posts)), CurveB=sorted_posts)  # -> PointA, PointB, Distance
series_3 = Series(Start=0, Step=1, Count=lng_7)  # -> flatten(Series)
smaller_2 = SmallerThan(FirstNumber=crvprox.Distance, SecondNumber=intersection_distance_limit_inches)  # -> SmallerThan, OrEqualTo
int_2 = Integer(series_3)
cull_6 = CullPattern(List=crvprox.PointA, CullPattern=smaller_2.SmallerThan)
cull_7 = CullPattern(List=int_2, CullPattern=smaller_2.SmallerThan)
tstat = TreeStatistics(Tree=cull_7)  # -> Paths, Length, Count
dpath = DeconstructPath(Branch=tstat.Paths)
equals_4 = Equality(FirstNumber=cull_7, SecondNumber=graft(dpath))  # -> Equality, Inequality
cull_8 = CullPattern(List=cull_6, CullPattern=equals_4.Inequality)
cull_9 = CullPattern(List=cull_7, CullPattern=equals_4.Inequality)
crv_cp_2 = CurveClosestPoint(Point=cull_8, Curve=graft(sorted_posts))  # -> Point, Parameter, Distance
sort_3 = SortList(Keys=crv_cp_2.Parameter, ValuesA=cull_9)  # -> Keys, simplify(ValuesA)

# ---- group: label text
split_7 = SplitList(List=rectangle_2.Rectangle, Index=number_of_posts_2)  # -> ListA, ListB
series_4 = Series(Start=0, Step=1, Count=number_of_posts_2)
offset = Offset(Curve=split_7.ListA, Distance=expr("-x", Slider(0.1, range=0..0.1)), Plane=PlaneXY(0, 0, 0), Corners=1)  # -> flatten(Curve)
int_3 = Integer(series_4)
explode_2 = Explode(Curve=offset, Recursive=True)  # -> Segments, Vertices
newline = Panel("  ")
item_13 = ListItem(List=explode_2.Segments, Index=0, Wrap=True)  # -> Item, Item1, Item2, Item3
createatts_3 = CreateAttributes(LayerName="text", enableFullPath=False)
join = TextJoin(Text=sort_3.ValuesA, Join=newline)
curvepoint_3 = PointOnCurve(item_13.Item1, parameter=0)
curvepoint_4 = PointOnCurve(item_13.Item3, parameter=0)
justified_text = JustifiedText3d(
    Location=flatten(curvepoint_4),
    Text=int_3,
    Size=Slider(0.41, range=0..1),
    HorizontalAlignment=0,
    VerticalAlginment=2,
    UseMeshes=False,
    Attributes=createatts_3,
    Bake=bake_labels)
justified_text_2 = JustifiedText3d(
    Location=flatten(curvepoint_3),
    Text=flatten(join),
    Size=Slider(0.23, range=0..1),
    HorizontalAlignment=2,
    VerticalAlginment=0,
    UseMeshes=False,
    Attributes=createatts_3,
    Bake=bake_labels)

# ---- group: post lengths
long = LongestList(ListA=pl, ListB=combine.Result, PaddingMode=2)  # -> ListA, graft(ListB)
tstat_2 = TreeStatistics(Tree=long.ListB)  # -> Paths, Length, Count
cset = CreateSet(List=long.ListB)  # -> Set, Map
replace_2 = ReplacePaths(Data=long.ListB, Search=tstat_2.Paths, Replace=flatten(cset.Map))
lng_8 = ListLength(List=replace_2)
format_4 = Format(Format="{0}\" - {1}", Culture=127, Data0=combine.Result, Data1=lng_8)

# ----
post_lengths_3 = Panel(format_4)

# ==== cluster PathOffset
clip = ClusterInput()  # When not wrapping, clip paths to original tree size.
wrap = ClusterInput()  # Wrap paths? List length should match path length.
offset = ClusterInput()  # Path offset to apply
T = ClusterInput()
tstat = TreeStatistics(Tree=T)  # -> Paths, Length, Count
dpath = DeconstructPath(Branch=tstat.Paths)
dpath_2 = DeconstructPath(Branch=offset)
addition = Addition(A=dpath, B=dpath_2)
flip = FlipMatrix(Data=dpath)
bnd = Bounds(Numbers=flip)  # -> flatten(Domain)
dedomain = DeconstructDomain(Domain=bnd)  # -> Start, End
bool = Boolean(wrap)
bool_2 = Boolean(clip)
expression = Expression(x=addition, s=dedomain.Start, e=dedomain.End, w=bool, Expression="If(w, int(( (x+abs(x)*(e-s+1)) -s)%(e-s+1) + s), x)")
expression_2 = Expression(x=expression, s=dedomain.Start, e=dedomain.End, w=bool, c=bool_2, Expression="If(not w and c, (x≥s) and (x≤e), True)")
path = ConstructPath(Indices=expression)
mm = MassMultiplication(Input=expression_2)  # -> Result, PartialResults
replace = ReplacePaths(Data=T, Search=tstat.Paths, Replace=flatten(path))
cull = CullPattern(List=replace, CullPattern=mm.Result)
clean = CleanTree(RemoveNulls=False, RemoveInvalid=True, RemoveEmpty=True, Tree=cull)
T_2 = ClusterOutput(clean)
